# Grasshopper definition Herring_brick_fabrication_comb.ghx (Grasshopper 1.0.7)

series = Series(Start=0, Step=1, Count="8")
final_herringbone_planes = Plane(Tree({0}: [Plane(origin=(26.7, 6, 8), x=(0, 1, 0), y=(-1, 0, 0)), Plane(origin=(41.7, 21, 8), x=(0, 1, 0), y=(-1, 0, 0)), Plane(origin=(56.7, 36, 8), x=(0, 1, 0), y=(-1, 0, 0)), Plane(origin=(71.7, 51, 8), x=(0, 1, 0), y=(-1, 0, 0)), Plane(origin=(86.7, 66, 8), x=(0, 1, 0), y=(-1, 0, 0)), PlaneXY(6, 12.35, 8)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], {1}: [Plane(origin=(25.03092486, -8.012555427, 16), x=(0.9999616301, -0.008760047063, 0), y=(0.008760047063, 0.9999616301, 0)), Plane(origin=(25.92599457, 8.761196935, 16), x=(0.9945218954, 0.1045284633, 0), y=(-0.1045284633, 0.9945218954, 0)), Plane(origin=(39.27589605, 25.24695231, 16), x=(0.9945218954, 0.1045284633, 0), y=(-0.1045284633, 0.9945218954, 0)), Plane(origin=(52.62579753, 41.73270769, 16), x=(0.9945218954, 0.1045284633, 0), y=(-0.1045284633, 0.9945218954, 0)), Plane(origin=(65.97569901, 58.21846307, 16), x=(0.9945218954, 0.1045284633, 0), y=(-0.1045284633, 0.9945218954, 0)), Plane(origin=(4.67563559, 12.91267178, 16), x=(-0.1045284633, 0.9945218954, 0), y=(-0.9945218954, -0.1045284633, 0))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], {2}: [Plane(origin=(26.85456943, 5.12415152, 24), x=(-0.02090075226, 0.9997815554, 0), y=(-0.9997815554, -0.02090075226, 0)), Plane(origin=(27.72815411, -21.60462851, 24), x=(-0.02090075226, 0.9997815554, 0), y=(-0.9997815554, -0.02090075226, 0)), Plane(origin=(3.299710969, 13.33382741, 24), x=(0.9781476007, 0.2079116908, 0), y=(-0.2079116908, 0.9781476007, 0)), Plane(origin=(71.08176014, 82.58991964, 24), x=(-0.2079116908, 0.9781476007, 0), y=(-0.9781476007, -0.2079116908, 0)), Plane(origin=(14.85324962, 31.12471678, 24), x=(0.9781476007, 0.2079116908, 0), y=(-0.2079116908, 0.9781476007, 0)), Plane(origin=(26.40678827, 48.91560616, 24), x=(0.9781476007, 0.2079116908, 0), y=(-0.2079116908, 0.9781476007, 0))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], {3}: [Plane(origin=(27.61625594, -7.797106053, 32), x=(-0.02090075226, 0.9997815554, 0), y=(-0.9997815554, -0.02090075226, 0)), Plane(origin=(23.53642886, 13.96629553, 32), x=(0.9510565163, 0.3090169944, 0), y=(-0.3090169944, 0.9510565163, 0)), Plane(origin=(33.16702169, 32.86739819, 32), x=(0.9510565163, 0.3090169944, 0), y=(-0.3090169944, 0.9510565163, 0)), Plane(origin=(1.887301057, 13.60885262, 32), x=(-0.3090169944, 0.9510565163, 0), y=(-0.9510565163, -0.3090169944, 0)), Plane(origin=(42.79761452, 51.76850085, 32), x=(0.9510565163, 0.3090169944, 0), y=(-0.3090169944, 0.9510565163, 0)), Plane(origin=(52.42820735, 70.66960351, 32), x=(0.9510565163, 0.3090169944, 0), y=(-0.3090169944, 0.9510565163, 0))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], {4}: [Plane(origin=(26.85456943, 5.12415152, 40), x=(-0.02090075226, 0.9997815554, 0), y=(-0.9997815554, -0.02090075226, 0)), Plane(origin=(27.72815411, -21.60462851, 40), x=(-0.02090075226, 0.9997815554, 0), y=(-0.9997815554, -0.02090075226, 0)), Plane(origin=(0.4538805121, 13.73473418, 40), x=(0.9135454576, 0.4067366431, 0), y=(-0.4067366431, 0.9135454576, 0)), Plane(origin=(8.056012731, 33.53896569, 40), x=(0.9135454576, 0.4067366431, 0), y=(-0.4067366431, 0.9135454576, 0)), Plane(origin=(52.35557804, 95.57009507, 40), x=(-0.4067366431, 0.9135454576, 0), y=(-0.9135454576, -0.4067366431, 0)), Plane(origin=(15.65814495, 53.3431972, 40), x=(0.9135454576, 0.4067366431, 0), y=(-0.4067366431, 0.9135454576, 0))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], {5}: [Plane(origin=(27.61625594, -7.797106053, 48), x=(-0.02090075226, 0.9997815554, 0), y=(-0.9997815554, -0.02090075226, 0)), Plane(origin=(20.11688005, 18.56083158, 48), x=(0.8660254038, 0.5, 0), y=(-0.5, 0.8660254038, 0)), Plane(origin=(25.6072611, 39.05121263, 48), x=(0.8660254038, 0.5, 0), y=(-0.5, 0.8660254038, 0)), Plane(origin=(-0.9848458108, 13.71009289, 48), x=(-0.5, 0.8660254038, 0), y=(-0.8660254038, -0.5, 0)), Plane(origin=(31.09764216, 59.54159369, 48), x=(0.8660254038, 0.5, 0), y=(-0.5, 0.8660254038, 0)), Plane(origin=(36.58802322, 80.03197475, 48), x=(0.8660254038, 0.5, 0), y=(-0.5, 0.8660254038, 0))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]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))
viewer = ParamViewer(final_herringbone_planes)
final_herringbone_planes_forrobot = Plane(flatten(final_herringbone_planes))
path = DataPath(series)
split = SplitTree(Data=final_herringbone_planes, Masks=flatten(path))  # -> Positive, Negative
addition = Addition(A="-72", B="8")
Z = UnitZ(Factor=addition)
move = Move(Geometry=split.Negative, Motion=Z)  # -> Geometry, Transform
panel = Panel(move.Geometry)

# ---- group: change it
number_slider = Slider(8, range=0..18)

# ----
series_2 = Series(Start=number_slider, Step=1, Count=Slider(1, range=0..100))

# ---- group: Oriented plan
panel_2 = Panel("""{299, 63, 0}
{499, 63, 0}
{499, 299, 0}""")
# Create Bricks
number_slider_2 = Slider(20, range=0..100)
pt = Point(panel_2)
pline = PolyLine(Vertices=pt, Closed=False)
points = PointList(Points=pt, Size=number_slider_2)

# ----
# Main Program
robotmodel = Geometry([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])
panel_3 = Panel(series_2)
# Roate decrease number of brick by Rules
branch = TreeBranch(Tree=move.Geometry, Path=series_2, MaintainPaths=True)

# ---- group: adjust Z value
number_slider_3 = Slider(0, range=-5..5)

# ----
Z_2 = UnitZ(Factor=number_slider_3)
Y = UnitY(Factor=Slider(100, range=0..100))
move_2 = Move(Geometry=branch, Motion=Z_2)  # -> Geometry, Transform
move_3 = Move(Geometry=pline, Motion=Y)  # -> Geometry, Transform
explode = Explode(Curve=move_3.Geometry, Recursive=True)  # -> Segments, Vertices
panel_4 = Panel(explode.Vertices)
final_herringbone_planes_forrobot_2 = Plane(flatten(move_2.Geometry))

# ---- group: change to run after test
list = ValueList({"Test first one": 0, "run______": 1}, selected="run______")

# ----
item = ListItem(List=final_herringbone_planes_forrobot_2, Index=0, Wrap=True)
filter = StreamFilter(Gate=list, Stream0=item, Stream1=final_herringbone_planes_forrobot_2)
# Robotic Fabrication
planetorobot = Plane(flatten(filter))

# ---- group: SEND TO ROBOT
button = Button()

# ---- group: Total Counts
lng = ListLength(List=flatten(filter))
panel_5 = Panel(lng)

# ----
plane = Geometry(flatten(planetorobot))
fabrication = GhPythonScript(way_plane=plane, send=button)  # -> out, robot_planes, pick_up_plane, glue_plane, script; inputs way_plane: list
# ---------- fabrication: Python ----------
from compas_rhino import unload_modules
unload_modules('model')
from model import Brick

import Rhino.Geometry as rg
import simple_comm as c
import simple_ur_script as ur
import math as m


rhino_base_way_planes = way_plane

def tcp(script):
    """ This funktion sets tcp 
    """
    script += ur.set_tcp_by_angles(
        0.0, 0.0, 70, m.radians(0.0), m.radians(180.0), m.radians(0))
    return script


### set robot orint plane
def set_robot_base_plane_from_pts():

    pt_0 = rg.Point3d(299, 163, 0)  # base plane origin
    # point on base plane positive x direction
    pt_1 = rg.Point3d(499, 163, 0)
    pt_2 = rg.Point3d(499, 399, 0)  # point on base plane positive xy

    robot_base = rg.Plane(pt_0, pt_1-pt_0, pt_2-pt_0)
    return robot_base

def rhino_to_robot_space(rhino_plane):
    """ this funktion translates planes from the rhino cordinate system to
    the robot cordinate system 
    """
    robot_plane = rhino_plane.Clone()
    _r_matrix = rg.Transform.PlaneToPlane(rg.Plane.WorldXY, set_robot_base_plane_from_pts())
    robot_plane.Transform(_r_matrix)
    return robot_plane

def pickup_brick(pick_up_plane, script):
    """Pick up a brick procedure

    Parameters
    ----------
    pick_up_plane : rhino.geometry.plane
    
    Returns:
    Procedure for pickin up plane
    """
    accel = 0.3    # m/s2
    vel = 0.8      # m/s

    safe_distance = 50
    
    way_planes = []

    safe_plane = pick_up_plane.Clone()
    safe_plane.Translate(rg.Vector3d(0, 0, safe_distance))

    script += ur.move_l(safe_plane, accel, vel)
    way_planes.append(safe_plane)

    script += ur.move_l(pick_up_plane, accel, vel)
    way_planes.append(pick_up_plane)

    script += ur.set_digital_out(0, True)
    script += ur.sleep(1)

    script += ur.move_l(safe_plane, accel, vel)
    way_planes.append(safe_plane)

    return script 

def place_brick(plane, script):
    """
    this function gereates the robotic sequience for placing a brick
    Requires a plane wich describes the possition of the brick"""

    safe_distance = 50
    accel = 0.1
    vel = 0.3
    way_planes = []

    safe_plane = plane.Clone()
    safe_plane.Translate(rg.Vector3d(0, 0, safe_distance))

    script += ur.move_l(safe_plane, accel, vel)
    way_planes.append(safe_plane)

    script += ur.move_l(plane, accel, vel)
    way_planes.append(plane)

    script += ur.set_digital_out(0, False)
    script += ur.sleep(1)

    script += ur.move_l(safe_plane, accel, vel)
    way_planes.append(safe_plane)

    return script

def glue(plane, script):
    """
    this function gereates the robotic sequience for using_glue
    Requires a plane wich describes the possition of the brick"""

    safe_distance = 50
    accel = 0.5
    vel = 1
    
    way_planes = []

    safe_plane = plane.Clone()
    safe_plane.Translate(rg.Vector3d(0, 0, safe_distance))

    script += ur.move_l(safe_plane, accel, vel)
    way_planes.append(safe_plane)

    script += ur.move_l(plane, accel, vel)
    way_planes.append(plane)
    
    script += ur.move_l(safe_plane, accel, vel)
    way_planes.append(safe_plane)

    return script



""" Robotic fabrication procedure
"""
script = ""
script = tcp(script)

"""pick _up plane is measured in the robot base plane
"""
#pick_up_planes =[]
#for i in range(1):  # rows x-direction
#    for j in range(12):  # rows y-direction
#        for k in range(6):
#            x_pos = k * (Brick.REFERENCE_LENGTH)
#            y_pos = j * (Brick.REFERENCE_WIDTH)
#            z_pos = i * (Brick.REFERENCE_HEIGHT)
#            origin = rg.Point3d(-60+x_pos, 508-y_pos, 6.0+z_pos)
#            pick_up_plane = rg.Plane(origin, rg.Vector3d.XAxis, rg.Vector3d.YAxis)
#            pick_up_plane.Rotate(m.radians(-90), rg.Vector3d.ZAxis)
#            pick_up_planes.append(pick_up_plane)
#pick_up_planes.reverse()
#print(pick_up_planes)

origin = rg.Point3d(-60, 508, 6.0)
pick_up_plane = rg.Plane(origin, rg.Vector3d.XAxis, rg.Vector3d.YAxis)
pick_up_plane.Rotate(m.radians(-90), rg.Vector3d.ZAxis)

#print(Brick.REFERENCE_LENGTH)
robot_planes = []

"""We are translating all way_planes from rhino base to robot_base
"""
for rhino_plane in (rhino_base_way_planes):
    robot_planes.append(rhino_to_robot_space(rhino_plane))

glue_plane = rg.Plane(rg.Point3d(178.4, 466.2, 17.5), rg.Vector3d.XAxis, rg.Vector3d.YAxis)
glue_plane.Rotate(m.radians(-90), rg.Vector3d.ZAxis)


# set the start postion 
s_pos = [ m.radians(94.51),
   m.radians(-85.99),
   m.radians(-126.91),
   m.radians(-57.21),
   m.radians(90),
   m.radians(0)]
script += ur.move_j(s_pos, 0.4, 0.4)

#for i in range(len(robot_planes)-1):
#    #pick up a plane 
#    if i< 41:
#        script = pickup_brick(pick_up_planes[i], script)
#        script = place_brick(robot_planes[i], script)
#    else:
#        script = pickup_brick(pick_up_planes[i], script)
#        script = glue(glue_plane, script)
#        script = place_brick(robot_planes[i], script)


for robot_plane in (robot_planes):
    #pick up a plane 
    script = pickup_brick(pick_up_plane, script)
    script = glue(glue_plane, script)
    script = place_brick(robot_plane, script)


script = c.concatenate_script(script)

if send == True :
    c.send_script(script, "192.168.10.10")
# ---------- end fabrication ----------

# ---- group: Gule
number_slider_4 = Slider(75, range=0..1000)
dom = ConstructDomain(DomainStart=number_slider_4, DomainEnd=expr("x*-1", number_slider_4))
pt_2 = Point(fabrication.glue_plane)
rectangle = Rectangle(Plane=pt_2, XSize=dom, YSize=dom, Radius=0)  # -> Rectangle, Length

# ---- group: Brick
pln = Plane(fabrication.robot_planes)
points_2 = PointList(Points=pln, Size=Slider(3.03, range=0..10))

# ---- group: Robot_ enviroment
# Visualization
swatch = ColourSwatch(SwatchColor=RGBA(255, 255, 255, 46))
preview = CustomPreview(Geometry=robotmodel, Material=swatch)

# ----
number_slider_5 = Slider(10, range=0..10)
panel_6 = Panel(fabrication.script)
pln_2 = Plane(fabrication.pick_up_plane)
box = CenterBox(Base=pln, X=Slider(12.35, range=0..100), Y=Slider(6, range=0..100), Z=Slider(4, range=0..10))
plnaxis = PlaneAxis(P=pln, B=number_slider_5)
plnaxis_2 = PlaneAxis(P=pln_2, B=number_slider_5)

# ==== cluster PlaneAxis: show plane X Y Z axis.
P = ClusterInput()
B = ClusterInput()
deplane = DeconstructPlane(Plane=graft(P))  # -> Origin, XAxis, YAxis, ZAxis
multiplication = Multiplication(A=[deplane.XAxis, deplane.YAxis, deplane.ZAxis], B=B)
vdisex = VectorDisplayEx(
    Point=deplane.Origin,
    Vector=multiplication,
    Colour=[ColourSwatch(SwatchColor=RGB(235, 52, 52)), ColourSwatch(SwatchColor=RGB(90, 207, 48)), ColourSwatch(SwatchColor=RGB(54, 126, 227))],
    Width=2)
